# Grasshopper definition 01_hcw.ghx (Grasshopper 1.0.7)

# ---- group: addition
panel = Panel("""2
2.7
-3.666
22222222222222222""")
panel_2 = Panel("""1
1.3
1.333
111111111111111""")
addition = Addition(A=panel_2, B=panel)
python = GhPythonScript(x=panel_2, y=panel)  # -> out, a
# ---------- python: Python ----------
a = float(x) + float(y)
# ---------- end python ----------
panel_3 = Panel(addition)
panel_4 = Panel(python.a)
equals = Equality(FirstNumber=addition, SecondNumber=python.a)  # -> Equality, Inequality
panel_5 = Panel(equals.Equality)

# ---- group: larger than
panel_6 = Panel("""2
2.7
-3.666
22222222222222222""")
panel_7 = Panel("""1
1.3
1.333
111111111111111""")
larger = LargerThan(FirstNumber=panel_7, SecondNumber=panel_6)  # -> LargerThan, OrEqualTo
python_2 = GhPythonScript(x=panel_7, y=panel_6)  # -> out, a, b
# ---------- python_2: Python ----------
if x > y :
    a = 'True'
else :
    a = 'False'

if x >= y :
    b = 'True'
else :
    b = 'False'
# ---------- end python_2 ----------
panel_8 = Panel(larger.LargerThan)
panel_9 = Panel(python_2.a)
panel_10 = Panel(python_2.b)
panel_11 = Panel(larger.OrEqualTo)
equals_2 = Equality(FirstNumber=larger.OrEqualTo, SecondNumber=python_2.b)  # -> Equality, Inequality
equals_3 = Equality(FirstNumber=larger.LargerThan, SecondNumber=python_2.a)  # -> Equality, Inequality
panel_12 = Panel(equals_2.Equality)
panel_13 = Panel(equals_3.Equality)

panel_14 = Panel("""ABC
123456789123456789""")
panel_15 = Panel("""DEF
-123456789123456788""")

# ---- group: addition
panel_16 = Panel("""ABC
123456789123456789""")
panel_17 = Panel("""DEF
-123456789123456788""")

python_3 = GhPythonScript(x=panel_16, y=panel_17)  # -> out, a
# ---------- python_3: Python ----------
try :
    a = float(x) + float(y)
except :
    a = x + y
# ---------- end python_3 ----------
panel_18 = Panel(python_3.a)

# ---- group: absolute
panel_19 = Panel("""2
2.7
-3.666
22222222222222222""")
abs = Absolute(Value=panel_19)
python_4 = GhPythonScript(x=panel_19)  # -> out, a
# ---------- python_4: Python ----------
a = abs(float(x))
# ---------- end python_4 ----------
panel_20 = Panel(abs)
panel_21 = Panel(python_4.a)
equals_4 = Equality(FirstNumber=abs, SecondNumber=python_4.a)  # -> Equality, Inequality
panel_22 = Panel(equals_4.Equality)

panel_23 = Panel("DEF")
vec = VectorXYZ(XComponent="1", YComponent="-30", ZComponent="30")  # -> Vector, Length

panel_24 = Panel(vec.Vector)
abs_2 = Absolute(Value=panel_24)
python_5 = GhPythonScript(x=panel_24)  # -> out, a
# ---------- python_5: Python ----------
import Rhino.Geometry as rg

x = x.replace("{", "").replace("}", "").split(",")
abs = [abs(float(i)) for i in x]
a = rg.Vector3d(abs[0], abs[1], abs[2])
# ---------- end python_5 ----------
panel_25 = Panel(abs_2)
panel_26 = Panel(python_5.a)
equals_5 = Equality(FirstNumber=abs_2, SecondNumber=python_5.a)  # -> Equality, Inequality
panel_27 = Panel(equals_5.Equality)

abs_3 = Absolute(Value=vec.Vector)
python_6 = GhPythonScript(x=vec.Vector)  # -> out, a
# ---------- python_6: Python ----------
import Rhino.Geometry as rg

a = rg.Vector3d(abs(x.X), abs(x.Y), abs(x.Z))
# ---------- end python_6 ----------
panel_28 = Panel(abs_3)
panel_29 = Panel(python_6.a)
equals_6 = Equality(FirstNumber=abs_3, SecondNumber=python_6.a)  # -> Equality, Inequality
panel_30 = Panel(equals_6.Equality)

# ---- group: mass multiplication
panel_31 = Panel("""2
2.7
-3.666""")
python_7 = GhPythonScript(x=panel_31)  # -> out, a, b; inputs x: list
# ---------- python_7: Python ----------
a = 1
b = []

for i in x :
    a *= float(i)
    b.append(a)
# ---------- end python_7 ----------
mm = MassMultiplication(Input=panel_31)  # -> Result, PartialResults
panel_32 = Panel(mm.Result)
panel_33 = Panel(mm.PartialResults)
panel_34 = Panel(python_7.a)
panel_35 = Panel(python_7.b)
equals_7 = Equality(FirstNumber=mm.PartialResults, SecondNumber=python_7.b)  # -> Equality, Inequality
equals_8 = Equality(FirstNumber=mm.Result, SecondNumber=python_7.a)  # -> Equality, Inequality
panel_36 = Panel(equals_8.Equality)
panel_37 = Panel(equals_7.Equality)

# ---- group: bounds
panel_38 = Panel("""1
2
3
4
5""")
python_8 = GhPythonScript(x=panel_38)  # -> out, a; inputs x: list
# ---------- python_8: Python ----------
import Rhino.Geometry as rg

a = rg.Interval(float(min(x)), float(max(x)))
# ---------- end python_8 ----------
bnd = Bounds(Numbers=panel_38)
panel_39 = Panel(bnd)
panel_40 = Panel(python_8.a)
equals_9 = Equality(FirstNumber=bnd, SecondNumber=panel_39)  # -> Equality, Inequality
