# Grasshopper definition absolute.gh (Grasshopper 1.0.7)

panel = Panel("""2
2.7
-3.666
22222222222222222""")
abs = Absolute(Value=panel)
python = GhPythonScript(x=panel)  # -> out, a
# ---------- python: Python ----------
a = abs(float(x))
# ---------- end python ----------
panel_2 = Panel(abs)
panel_3 = Panel(python.a)
equals = Equality(FirstNumber=abs, SecondNumber=python.a)  # -> Equality, Inequality
panel_4 = Panel(equals.Equality)

panel_5 = Panel("DEF")
vec = VectorXYZ(XComponent="1", YComponent="-30", ZComponent="30")  # -> Vector, Length

panel_6 = Panel(vec.Vector)
abs_2 = Absolute(Value=panel_6)
python_2 = GhPythonScript(x=panel_6)  # -> out, a
# ---------- python_2: Python ----------
import Rhino.Geometry as rg

x = x.replace("{", "").replace("}", "").split(",")
abs = [abs(float(i)) for i in x]
a = rg.Vector3d(abs[0], abs[1], abs[2])
# ---------- end python_2 ----------
panel_7 = Panel(abs_2)
panel_8 = Panel(python_2.a)
equals_2 = Equality(FirstNumber=abs_2, SecondNumber=python_2.a)  # -> Equality, Inequality
panel_9 = Panel(equals_2.Equality)

abs_3 = Absolute(Value=vec.Vector)
python_3 = GhPythonScript(x=vec.Vector)  # -> out, a
# ---------- python_3: Python ----------
import Rhino.Geometry as rg

a = rg.Vector3d(abs(x.X), abs(x.Y), abs(x.Z))
# ---------- end python_3 ----------
panel_10 = Panel(abs_3)
panel_11 = Panel(python_3.a)
equals_3 = Equality(FirstNumber=abs_3, SecondNumber=python_3.a)  # -> Equality, Inequality
panel_12 = Panel(equals_3.Equality)
