# Grasshopper definition bounds.gh (Grasshopper 1.0.7)

panel = Panel("""1
2
3
4
5""")
python = GhPythonScript(x=panel)  # -> out, a; inputs x: list
# ---------- python: Python ----------
import Rhino.Geometry as rg

a = rg.Interval(float(min(x)), float(max(x)))
# ---------- end python ----------
bnd = Bounds(Numbers=panel)
panel_2 = Panel(bnd)
panel_3 = Panel(python.a)
equals = Equality(FirstNumber=bnd, SecondNumber=panel_2)  # -> Equality, Inequality
