# Grasshopper definition closest_point_easy.ghx (Grasshopper 1.0.7)

panel = Panel("C:\Users\Chaewon Hong\OneDrive - Chaewon\OneDrive\건축\그래스호퍼 컴포넌트 구현 프로젝트\02\grasshopper-component-challenges-main")
panel_2 = Panel("""def closest_point_easy(x, y):
    \"\"\"
    Closest Point (Easy)
    
    Args:
        x (Point3d): Point to search from.
        y (List[Point3d]): List of points to search.
    
    Retruns:
        (Tuple[Point3d, int, float])
        - Closest point from P in C.
        - Index of closest point in C.
        - Distance from closest point in C to P.
        
    \"\"\"

    closest_pt = None
    closest_idx = -1
    min_dist = float('inf')

    for i, pt in enumerate(y):
        dist = x.DistanceTo(pt)
        if dist < min_dist:
            closest_pt = pt
            closest_idx = i
            min_dist = dist
    
    return closest_pt, closest_idx, min_dist

a, b, c = closest_point_easy(x, y)""")
path = FilePath(panel)
closest_point_easy = Closest_point_easy(pkg_path=path, code=panel_2)  # -> result, result_2, result_3, gh_output, gh_output_3, gh_output_2, code_output, code_output_2, code_output_3
panel_3 = Panel(closest_point_easy.result)
panel_4 = Panel(closest_point_easy.result_2)
panel_5 = Panel(closest_point_easy.result_3)

# ==== cluster Closest_point_easy
pkg_path = ClusterInput()
code = ClusterInput()
testcases = GhPythonScript(pkg_path=pkg_path)  # -> a, b
# ---------- testcases: Python ----------
import sys
sys.path.append(pkg_path)

from ghpythonlib import treehelpers
from grasshopper_challenges.testcases import closest_point_easy

a = closest_point_easy.tc_p
b = treehelpers.list_to_tree(closest_point_easy.tc_c)
# ---------- end testcases ----------
python = GhPythonScript(Code=code, X=graft(testcases.a), Y=testcases.b)  # -> A, B, C
cp = ClosestPoint(Point=graft(testcases.a), Cloud=testcases.b)  # -> ClosestPoint, CPIndex, Distance
judge = GhPythonScript(pkg_path=pkg_path, x=cp.ClosestPoint, y=cp.CPIndex, z=cp.Distance, u=python.A, v=python.B, w=python.C)  # -> out, a, b, c; inputs x: Point3d, u: Point3d
# ---------- judge: Python ----------
import sys
sys.path.append(pkg_path)

from grasshopper_challenges.judges import closest_point_easy

a = closest_point_easy.judge_p(x, u)
b = closest_point_easy.judge_i(y, v)
c = closest_point_easy.judge_d(z, w)
# ---------- end judge ----------
gh_output = ClusterOutput(cp.ClosestPoint)
gh_output_2 = ClusterOutput(cp.Distance)
result = ClusterOutput(judge.a)
gh_output_3 = ClusterOutput(cp.CPIndex)
result_2 = ClusterOutput(judge.b)
code_output = ClusterOutput(python.A)
result_3 = ClusterOutput(judge.c)
code_output_2 = ClusterOutput(python.B)
code_output_3 = ClusterOutput(python.C)
