# Grasshopper definition larger-than.gh (Grasshopper 1.0.7)

panel = Panel("""ABC
123456789123456789""")
panel_2 = Panel("""DEF
-123456789123456788""")

panel_3 = Panel("""2
2.7
-3.666
22222222222222222""")
panel_4 = Panel("""1
1.3
1.333
111111111111111""")
larger = LargerThan(FirstNumber=panel_4, SecondNumber=panel_3)  # -> LargerThan, OrEqualTo
python = GhPythonScript(x=panel_4, y=panel_3)  # -> out, a, b
# ---------- python: Python ----------
if x > y :
    a = 'True'
else :
    a = 'False'

if x >= y :
    b = 'True'
else :
    b = 'False'
# ---------- end python ----------
panel_5 = Panel(larger.LargerThan)
panel_6 = Panel(python.a)
panel_7 = Panel(python.b)
panel_8 = Panel(larger.OrEqualTo)
equals = Equality(FirstNumber=larger.OrEqualTo, SecondNumber=python.b)  # -> Equality, Inequality
equals_2 = Equality(FirstNumber=larger.LargerThan, SecondNumber=python.a)  # -> Equality, Inequality
panel_9 = Panel(equals.Equality)
panel_10 = Panel(equals_2.Equality)
