# Grasshopper definition mass-multiplication.gh (Grasshopper 1.0.7)

panel = Panel("""2
2.7
-3.666""")
python = GhPythonScript(x=panel)  # -> out, a, b; inputs x: list
# ---------- python: Python ----------
a = 1
b = []

for i in x :
    a *= float(i)
    b.append(a)
# ---------- end python ----------
mm = MassMultiplication(Input=panel)  # -> Result, PartialResults
panel_2 = Panel(mm.Result)
panel_3 = Panel(mm.PartialResults)
panel_4 = Panel(python.a)
panel_5 = Panel(python.b)
equals = Equality(FirstNumber=mm.PartialResults, SecondNumber=python.b)  # -> Equality, Inequality
equals_2 = Equality(FirstNumber=mm.Result, SecondNumber=python.a)  # -> Equality, Inequality
panel_6 = Panel(equals.Equality)
panel_7 = Panel(equals_2.Equality)
