# Grasshopper definition dist_standard.ghx (Grasshopper 1.0.7)

panel = Panel("C:\Users\Chaewon Hong\OneDrive - Chaewon\OneDrive\건축\그래스호퍼 컴포넌트 구현 프로젝트\02\grasshopper-component-challenges-main")
panel_2 = Panel("""def distance_standard(x, y):
    \"\"\"
    Distance (standard)
    
    Args:
        x (Point3D): First point
        y (Point3D): Second point
    
    Retruns:
        Distance between two input points (number)
    \"\"\"

    import math

    return math.sqrt((y.X - x.X)**2 + (y.Y - x.Y)**2 + (y.Z - x.Z)**2)

a = distance_standard(x, y)""")
path = FilePath(panel)
distance_standard = Distance_standard(pkg_path=path, code=panel_2)  # -> result, gh_output, code_output
panel_3 = Panel(distance_standard.result)

# ==== cluster Distance_standard
pkg_path = ClusterInput()
code = ClusterInput()
testcases = GhPythonScript(pkg_path=pkg_path)  # -> a, b
# ---------- testcases: Python ----------
import sys
sys.path.append(pkg_path)

from grasshopper_challenges.testcases import distance_standard

a = distance_standard.tc_a
b = distance_standard.tc_b
# ---------- end testcases ----------
dist = Distance(PointA=testcases.a, PointB=testcases.b)
python = GhPythonScript(Code=code, X=testcases.a, Y=testcases.b)
judge = GhPythonScript(pkg_path=pkg_path, x=dist, y=python)  # -> out, a
# ---------- judge: Python ----------
import sys
sys.path.append(pkg_path)

from grasshopper_challenges.judges import distance_standard

a = distance_standard.judge(x, y)
# ---------- end judge ----------
result = ClusterOutput(judge.a)
gh_output = ClusterOutput(dist)
code_output = ClusterOutput(python)
