# Grasshopper definition unit_x_standard.ghx (Grasshopper 1.0.7)

panel = Panel("""def unit_x_standard(x):
    \"\"\"
    Unit X (standard)
    
    Args:
        x (float): Input value
    
    Retruns:
        Vector X multiplied by x
    \"\"\"
    
    import Rhino.Geometry as rg
    
    return rg.Vector3d(x, 0, 0)

a = unit_x_standard(x)""")
panel_2 = Panel("C:\Users\Chaewon Hong\OneDrive - Chaewon\OneDrive\건축\그래스호퍼 컴포넌트 구현 프로젝트\02\grasshopper-component-challenges-main")
path = FilePath(panel_2)
unit_x_standard = Unit_x_standard(pkg_path=path, code=panel)  # -> result, gh_output, code_output
panel_3 = Panel(unit_x_standard.result)

# ==== cluster Unit_x_standard
pkg_path = ClusterInput()
code = ClusterInput()
testcases = GhPythonScript(pkg_path=pkg_path)  # -> a
# ---------- testcases: Python ----------
import sys
sys.path.append(pkg_path)

from grasshopper_challenges.testcases import unit_x_standard

a = unit_x_standard.tc
# ---------- end testcases ----------
python = GhPythonScript(Code=code, X=testcases)
X = UnitX(Factor=testcases)
judge = GhPythonScript(pkg_path=pkg_path, x=X, y=python)  # -> out, a
# ---------- judge: Python ----------
import sys
sys.path.append(pkg_path)

from grasshopper_challenges.judges import unit_x_standard

a = unit_x_standard.judge(x, y)
# ---------- end judge ----------
result = ClusterOutput(judge.a)
gh_output = ClusterOutput(X)
code_output = ClusterOutput(python)
