# Grasshopper definition cull_nth_standard.ghx (Grasshopper 1.0.7)

panel = Panel("C:\Users\홍용표\OneDrive - Chaewon\OneDrive\건축\그래스호퍼 컴포넌트 구현 프로젝트\03\grasshopper-component-challenges-main")
panel_2 = Panel("""def cull_nth_standard(x, y):
    \"\"\"
    Cull nth (Standard)
    
    Args:
        x (List[Any]): List to cull.
        y (int): Cull yth.
    
    Retruns:
        (List[Any])
        Culled list.
        
    \"\"\"
   
    return [item for i, item in enumerate(x) if (i+1) % y != 0]

a = cull_nth_standard(x, y)""")
path = FilePath(panel)
cull_nth_standard = Cull_nth_standard(pkg_path=path, code=panel_2)  # -> result, gh_output, code_output
panel_3 = Panel(cull_nth_standard.result)

# ==== cluster Cull_nth_standard
pkg_path = ClusterInput()
code = ClusterInput()
testcases = GhPythonScript(pkg_path=pkg_path)  # -> simplify(a), graft(b)
# ---------- testcases: Python ----------
import sys
sys.path.append(pkg_path)

from ghpythonlib import treehelpers
from grasshopper_challenges.testcases import cull_nth_standard

a = treehelpers.list_to_tree(cull_nth_standard.tc_l)
b = cull_nth_standard.tc_n
# ---------- end testcases ----------
python = GhPythonScript(Code=code, X=testcases.a, Y=testcases.b)  # -> simplify(A)
culln = CullNth(List=testcases.a, CullFrequency=testcases.b)  # -> simplify(List)
judge = GhPythonScript(pkg_path=pkg_path, x=culln, y=python)  # -> out, a; inputs x: list, y: list
# ---------- judge: Python ----------
import sys
sys.path.append(pkg_path)

from grasshopper_challenges.judges import cull_nth_standard

a = cull_nth_standard.judge(x, y)
# ---------- end judge ----------
code_output = ClusterOutput(python)
gh_output = ClusterOutput(culln)
result = ClusterOutput(judge.a)
