# Grasshopper definition end_points_standard.ghx (Grasshopper 1.0.7)

panel = Panel("C:\Users\홍용표\OneDrive - Chaewon\OneDrive\건축\그래스호퍼 컴포넌트 구현 프로젝트\03\grasshopper-component-challenges-main")
panel_2 = Panel("""def end_points_standard(x):
    \"\"\"
    End Points (Standard)
    
    Args:
        x (Curve): Curve
    
    Retruns:
        (Tuple[Point3d, Point3d])
        - Start point of curve x.
        - End point of curve x.
    \"\"\"
    
    return x.PointAtStart, x.PointAtEnd

a, b = end_points_standard(x)""")
path = FilePath(panel)
end_points_standard = End_points_standard(pkg_path=path, code=panel_2)  # -> result_2, result, gh_output, gh_output_2, code_output, code_output_2
panel_3 = Panel(end_points_standard.result_2)
panel_4 = Panel(end_points_standard.result)

# ==== cluster End_points_standard
pkg_path = ClusterInput()
code = ClusterInput()
testcases = GhPythonScript(pkg_path=pkg_path)  # -> a
# ---------- testcases: Python ----------
import sys
sys.path.append(pkg_path)

from grasshopper_challenges.testcases import end_points_standard

a = end_points_standard.tc
# ---------- end testcases ----------
python = GhPythonScript(Code=code, X=testcases)  # -> A, B
end = EndPoints(Curve=testcases)  # -> Start, End
judge = GhPythonScript(pkg_path=pkg_path, x=end.Start, y=end.End, z=python.A, u=python.B)  # -> out, a, b; inputs x: Point3d, y: Point3d, z: Point3d, u: Point3d
# ---------- judge: Python ----------
import sys
sys.path.append(pkg_path)

from grasshopper_challenges.judges import end_points_standard

a = end_points_standard.judge_s(x, z)
b = end_points_standard.judge_e(y, u)
# ---------- end judge ----------
gh_output = ClusterOutput(end.Start)
code_output = ClusterOutput(python.A)
gh_output_2 = ClusterOutput(end.End)
code_output_2 = ClusterOutput(python.B)
result = ClusterOutput(judge.b)
result_2 = ClusterOutput(judge.a)
