# Grasshopper definition pi_standard.ghx (Grasshopper 1.0.7)

panel = Panel("C:\Users\홍용표\OneDrive - Chaewon\OneDrive\건축\그래스호퍼 컴포넌트 구현 프로젝트\03\grasshopper-component-challenges-main")
panel_2 = Panel("""import math

def pi_standard(x):
    \"\"\"
    Pi (standard)
    
    Args:
        x (float): Input value
    
    Retruns:
        x * pi
    \"\"\"
      
    return x * math.pi

a = pi_standard(x)""")
path = FilePath(panel)
pi_standard = Pi_standard(pkg_path=path, code=panel_2)  # -> result, gh_output, code_output
panel_3 = Panel(pi_standard.result)

# ==== cluster Pi_standard
pkg_path = ClusterInput()
code = ClusterInput()
testcases = GhPythonScript(pkg_path=pkg_path)  # -> a
# ---------- testcases: Python ----------
import sys
sys.path.append(pkg_path)

from grasshopper_challenges.testcases import pi_standard

a = pi_standard.tc
# ---------- end testcases ----------
pi = Pi(Factor=testcases)
python = GhPythonScript(Code=code, X=testcases)
judge = GhPythonScript(pkg_path=pkg_path, x=pi, y=python)  # -> out, a
# ---------- judge: Python ----------
import sys
sys.path.append(pkg_path)

from grasshopper_challenges.judges import pi_standard

a = pi_standard.judge(x, y)
# ---------- end judge ----------
result = ClusterOutput(judge.a)
gh_output = ClusterOutput(pi)
code_output = ClusterOutput(python)
