# Grasshopper definition round_standard.ghx (Grasshopper 1.0.7)

panel = Panel("C:\Users\홍용표\OneDrive - Chaewon\OneDrive\건축\그래스호퍼 컴포넌트 구현 프로젝트\03\grasshopper-component-challenges-main")
panel_2 = Panel("""import math

def round_standard(x):
    \"\"\"
    Round (Standard)
    
    Args:
        x (float): Input value
    
    Retruns:
        (Tuple[int, int, int])
        - Neareast integer to x.
        - Floor value of x.
        - Ceiling value of x.
    \"\"\"
    
    return int(math.floor(x + 0.5)) if x >= 0 else int(math.ceil(x - 0.5)), int(math.floor(x)), int(math.ceil(x))

a, b, c = round_standard(x)""")
path = FilePath(panel)
round_standard = Round_standard(pkg_path=path, code=panel_2)  # -> result_3, result, result_2, gh_output, gh_output_2, gh_output_3, code_output, code_output_2, code_output_3
panel_3 = Panel(round_standard.result_3)
panel_4 = Panel(round_standard.result_2)
panel_5 = Panel(round_standard.result)

# ==== cluster Round_standard
pkg_path = ClusterInput()
code = ClusterInput()
testcases = GhPythonScript(pkg_path=pkg_path)  # -> a
# ---------- testcases: Python ----------
import sys
sys.path.append(pkg_path)

from grasshopper_challenges.testcases import round_standard

a = round_standard.tc
# ---------- end testcases ----------
round = Round(Number=testcases)  # -> Nearest, Floor, Ceiling
python = GhPythonScript(Code=code, X=testcases)  # -> A, B, C
judge = GhPythonScript(pkg_path=pkg_path, x=round.Nearest, y=round.Floor, z=round.Ceiling, u=python.A, v=python.B, w=python.C)  # -> out, a, b, c
# ---------- judge: Python ----------
import sys
sys.path.append(pkg_path)

from grasshopper_challenges.judges import round_standard

a = round_standard.judge_n(x, u)
b = round_standard.judge_f(y, v)
c = round_standard.judge_c(z, w)
# ---------- end judge ----------
gh_output = ClusterOutput(round.Nearest)
code_output = ClusterOutput(python.A)
gh_output_2 = ClusterOutput(round.Floor)
code_output_2 = ClusterOutput(python.B)
gh_output_3 = ClusterOutput(round.Ceiling)
code_output_3 = ClusterOutput(python.C)
result = ClusterOutput(judge.b)
result_2 = ClusterOutput(judge.c)
result_3 = ClusterOutput(judge.a)
