# Grasshopper definition delete_consecutive_standard.ghx (Grasshopper 1.0.7)

panel = Panel("C:\Users\Chaewon Hong\OneDrive - Chaewon\OneDrive\건축\그래스호퍼 컴포넌트 구현 프로젝트\04\grasshopper-component-challenges-main")
panel_2 = Panel("""def delete_consecutive_standard(x, y):
    \"\"\"
    Delete Consecutive (Standard)
    
    Args:
        x (List[Any]): List to process.
        y (bool): Wrap list.
    
    Retruns:
        (List[Any], int)
        - New list with consecutive same items removed.
        - Number of removed Items.
        
    \"\"\"

    L = [x[0]]
    C = 0

    for i in range(1, len(x)):
        if x[i] == x[i-1]:
            C += 1
        else:
            L.append(x[i])

    if y == True and len(L) > 1 and L[0] == L[-1]:
        L = L[:-1]
        C += 1

    return L, C

a, b = delete_consecutive_standard(x, y)""")
path = FilePath(panel)
delete_consecutive_standard = Delete_consecutive_standard(pkg_path=path, code=panel_2)  # -> result, result_2, gh_output, gh_output_2, code_output, code_output_2
panel_3 = Panel(delete_consecutive_standard.result_2)
panel_4 = Panel(delete_consecutive_standard.result)

# ==== cluster Delete_consecutive_standard
pkg_path = ClusterInput()
code = ClusterInput()
testcases = GhPythonScript(pkg_path=pkg_path)  # -> simplify(a), graft(b)
# ---------- testcases: Python ----------
import sys
sys.path.append(pkg_path)

from ghpythonlib import treehelpers
from grasshopper_challenges.testcases import delete_consecutive_standard

a = treehelpers.list_to_tree(delete_consecutive_standard.tc_s)
b = delete_consecutive_standard.tc_w
# ---------- end testcases ----------
python = GhPythonScript(Code=code, X=testcases.a, Y=testcases.b)  # -> simplify(A), B
dcon = DeleteConsecutive(Set=testcases.a, Wrap=testcases.b)  # -> Set, Count
judge = GhPythonScript(pkg_path=pkg_path, x=dcon.Set, y=dcon.Count, z=python.A, u=python.B)  # -> out, a, b; inputs x: list, z: list
# ---------- judge: Python ----------
import sys
sys.path.append(pkg_path)

from grasshopper_challenges.judges import delete_consecutive_standard

print(x,z)
a = delete_consecutive_standard.judge_s(x, z)
b = delete_consecutive_standard.judge_n(y, u)
# ---------- end judge ----------
code_output = ClusterOutput(python.A)
code_output_2 = ClusterOutput(python.B)
gh_output = ClusterOutput(dcon.Set)
gh_output_2 = ClusterOutput(dcon.Count)
result = ClusterOutput(judge.a)
result_2 = ClusterOutput(judge.b)
